# Grasshopper definition CISER-Script.ghx (Grasshopper 1.0.7)
# plug-ins: Eddy3D

panel = Panel("""0
45""")
templates = Templates()
panel_2 = Panel("""RRSCHG1
RRSCHG2
RSCH1
RSCH2
RSCH3
RSCH4
RSCH5
RSCH6""")
panel_3 = Panel("""8
8
3
3
3
3
3
3""")

# ----
# 1. Geometry &
# Boundary Conditions
geo = Geometry([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])
abl = ABL(WDir=panel, Uref="10", Zref=10, Z0=1, ZGround=0)

# ----
# 2. Simulation Domain
number_slider = Slider(50, range=0..1000)

domaincyl = CylindricalDomain(
    Geometry=geo,
    BoundaryCondition=abl,
    BlockSize="10",
    SizeOfInnerRectangle=number_slider,
    SizeOfOuterRadius=Slider(300, range=0..1000),
    Height=Slider(80, range=0..1000))  # -> Domain, Mesh

cellsize = CellSize(SimulationDomain=domaincyl.Domain, BlockSize="10", DesiredCellSize=Slider(3, range=0..10))

# ----
# 3. Mesh & Simulation
panel_4 = Panel("C:\4_AnnualWindAnalysis")
panel_5 = Panel("-1")
mset = MeshSettings(AccBuilding=cellsize, AccFeatures=cellsize, AccRefinement=0, AccGround=cellsize, NLayer=3, Mode=1, Mode_2=1)

sim = GhPythonScript(
    wind_dirs=panel,
    working_dir=panel_4,
    CISER_dir="S:\ESLAAP\AAA",
    cpus_per_task="6",
    machines=panel_2,
    tasks_per_machine=panel_3)  # -> out, a; inputs wind_dirs: list of Int32, cpus_per_task: Int32, machines: list, tasks_per_machine: list of Int32
# ---------- sim: Python ----------
__author__ = "pk373"
__version__ = "2020.10.09"

import rhinoscriptsyntax as rs
import os

if not os.path.exists(working_dir + "\ciser\\"):
    os.makedirs(working_dir + "\ciser\\")


template = "call \"U:\cfd\setvars.bat\"\nset PATH=%HOME%\msys64\usr\\bin;%PATH%\n{3}\nrobocopy  {4}\{0}\ {2}\{0}\ /E \ncd \"{2}\{0}\" \n\nblockMesh \nsurfaceFeatureExtract \ndecomposePar -force \nmpiexec -np {1} snappyHexMesh -overwrite -parallel \nreconstructParMesh -constant \nrenumberMesh -overwrite"

dirName = os.path.join(working_dir , "\ciser\\")
copy_from = "\\\\tsclient\\"+working_dir[0]+ str(working_dir[2:])

if not os.path.exists(dirName):
    os.makedirs(dirName)


template_f = template.format("mesh",cpus_per_task, CISER_dir, CISER_dir[:2], copy_from)
template_f  =template_f + "\n" + "\n"
for dir in wind_dirs:
    template_f += "robocopy " + CISER_dir + "\mesh\\ " + CISER_dir + "\\" + str(dir) + "\n"
    


if os.path.isfile(working_dir +"\ciser\\run_mesh.bat"):
    os.remove(working_dir +"\ciser\\run_mesh.bat")
   
f = open(working_dir +"\ciser\\run_mesh.bat", "a")
f.write(template_f)
f.close()
    




template = "call \"U:\cfd\setvars.bat\"\nset PATH=%HOME%\msys64\usr\\bin;%PATH%\n{3}\nrobocopy  {4}\{0}\ {2}\{0}\ /XD polyMesh /E \ncd \"{2}\{0}\" \n\ndecomposePar -force | tee -a log\nmpiexec -np {1} simpleFoam -parallel | tee -a log\nreconstructPar -latestTime | tee -a log"
dirName = os.path.join(working_dir , "\ciser\\")

if not os.path.exists(dirName):
    os.makedirs(dirName)

for dir in wind_dirs:
    template_f = template.format(dir, cpus_per_task, CISER_dir, CISER_dir[:2], copy_from)
    if os.path.isfile(working_dir +"\ciser\\"+str(dir)+"_run_sim.bat"):
        os.remove(working_dir +"\ciser\\"+str(dir)+"_run_sim.bat")
   
    f = open(working_dir +"\ciser\\"+str(dir)+"_run_sim.bat", "a")
    f.write(template_f)
    f.close()
    
    
template = "call \"U:\cfd\setvars.bat\"\nset PATH=%HOME%\msys64\usr\\bin;%PATH%\n{3}\ncd \"{2}\{0}\"\nmpiexec -np {1} simpleFoam -parallel | tee -a log\nreconstructPar -latestTime | tee -a log"
dirName = os.path.join(working_dir , "\ciser\\")

if not os.path.exists(dirName):
    os.makedirs(dirName)

for dir in wind_dirs:
    template_f = template.format(dir, cpus_per_task, CISER_dir, CISER_dir[:2])
    if os.path.isfile(working_dir +"\ciser\\"+str(dir)+"_run_sim_continue.bat"):
        os.remove(working_dir +"\ciser\\"+str(dir)+"_run_sim_continue.bat")
    f = open(working_dir +"\ciser\\"+str(dir)+"_run_sim_continue.bat", "a")
    f.write(template_f)
    f.close()
    
    
print(["s"+str(i+1) for i in range(len(machines))])




template = "call \"U:\cfd\setvars.bat\"\nset PATH=%HOME%\msys64\usr\\bin;%PATH%\n{3}\ncd \"{2}\{0}\"\nreconstructPar -latestTime | tee -a log"
dirName = os.path.join(working_dir , "\ciser\\")

if not os.path.exists(dirName):
    os.makedirs(dirName)

for dir in wind_dirs:
    template_f = template.format(dir, cpus_per_task, CISER_dir, CISER_dir[:2])
    if os.path.isfile(working_dir +"\ciser\\"+str(dir)+"_run_reconstruct.bat"):
        os.remove(working_dir +"\ciser\\"+str(dir)+"_run_reconstruct.bat")
    f = open(working_dir +"\ciser\\"+str(dir)+"_run_reconstruct.bat", "a")
    f.write(template_f)
    f.close()
    
    
print(["s"+str(i+1) for i in range(len(machines))])




template = "robocopy {1}\{0} \\\\tsclient\{2}\\{3} /XD processor*  /E /W:1 /R:1 \n"
s = []
dirName = os.path.join(working_dir , "\ciser\\")
copy_from = "\\\\tsclient\\"+working_dir[0]+ str(working_dir[2:])

if not os.path.exists(dirName):
    os.makedirs(dirName)
    
s.append(template.format("mesh",  CISER_dir, working_dir, "mesh").replace("C:","C").replace("E:","E"))
for dir in wind_dirs:
    s.append(template.format(dir,  CISER_dir, working_dir, dir).replace("C:","C").replace("E:","E"))
print(s)
    

f = open(working_dir +"\ciser\\copy_to_local.bat", "w")

f.write(''.join(str(e) for e in s))
f.close()



template = "robocopy  \\\\tsclient\{2}\\{3}  {1}\{0}\\  /E /W:1 /R:1\n"
s = []

dirName = os.path.join(working_dir , "\ciser\\")
copy_from = "\\\\tsclient\\"+working_dir[0]+ str(working_dir[2:])

if not os.path.exists(dirName):
    os.makedirs(dirName)

s.append(template.format("mesh",  CISER_dir, working_dir, "mesh").replace("C:","C").replace("E:","E"))
for dir in wind_dirs:
    s.append(template.format(dir,  CISER_dir, working_dir, dir).replace("C:","C").replace("E:","E"))

f = open(working_dir +"\ciser\\copy_to_ciser.bat", "w")

f.write(''.join(str(e) for e in s))
f.close()



template =  "call " + copy_from + "\ciser\{0}_run_sim.bat"
dirName = os.path.join(working_dir , "\ciser\\")

if not os.path.exists(dirName):
    os.makedirs(dirName)
    
def position(i,j,list):
    return sum(list[0:i])+j

for i,m in enumerate(machines):
    #print(i,m)
    s = ""
    for j in range(tasks_per_machine[i]):
        pos = position(i,j,tasks_per_machine)
        if pos < len(wind_dirs):
            template_f = template.format(wind_dirs[pos])
            s = s+template_f
        s= s+"\n"        

    if os.path.isfile(working_dir +"\ciser\\"+m+".bat"):
        os.remove(working_dir +"\ciser\\"+m+".bat")
    f = open(working_dir +"\ciser\\"+m+".bat", "a")
    f.write(s)
    f.close()
# ---------- end sim ----------
rset = RunSettings(
    NumberOfIterations="200",
    WriteInterval=20,
    NumberOfTimestepsToKeep=3,
    TurbulenceModel=1,
    RelaxationFactors=3,
    SolutionAndAlgorithmControl=1,
    PotentialFoamInitialization=False,
    AgeOfAir=True,
    NumberOfCPUs="6",
    OperatingSystem=0)
simulation = Simulation(
    SimulationDomain=domaincyl.Domain,
    WorkingDirectory=panel_4,
    MeshSettings=mset,
    RunSettings=rset,
    RunMeshing=Button(),
    MakeTrees=False,
    RunSimulation=Button(),
    runWithBlueCFD=True)
residuals = Residuals(Result=simulation, SelectionOfWindDirections="0", X=":", Y=":", Version=0, Run=Button(), visResiduals=False)

# ----
# 6. Clean
button = Button()
clean = Clean(Directory=panel_4, Mode=2, Run=button)
